# Dynamo graph Sanitary 03 - Import Excel.dyn (Dynamo 2.0.2.6826)

# group: 1. Select All Pipes of Plumbing - Sanitary Waste System
string = StringInput("Sanitary Waste")  # graph input
element_types = ElementTypes(index=230)  # graph input
all_elements_of_type = ElementsOfType(element_type=element_types)
code_block = CodeBlock { "System Type"; }
getParameterValueByName = Element.GetParameterValueByName(element=all_elements_of_type, parameterName=code_block)
name = Element.Name(element=getParameterValueByName)
eq = string == name
watch = Watch(eq)
filterByBoolMask = List.FilterByBoolMask(list=all_elements_of_type, mask=eq)

# group: 2. Import Pipe Diameter sized in Excel into Revit
file_path = Filename("C:\Users\dgardner\Desktop\SanitaryWritePipeDataToExcel.xlsx")  # graph input
fromPath = FileObject(path=file_path)  # "File.FromPath"
string_2 = StringInput("SanitaryCalcs")  # graph input
importExcel = Data.ImportExcel(file=fromPath@L1, sheetName=string_2)
transpose = List.Transpose(lists=importExcel)
code_block_2 = CodeBlock { 4; }
getItemAtIndex = List.GetItemAtIndex(list=transpose@L2, index=code_block_2)
code_block_3 = CodeBlock { "Diameter"; }

watch_2 = Watch(getItemAtIndex)

# group: 3. Resize Pipe Diameters in Revit
setParameterByName = Element.SetParameterByName(element=filterByBoolMask.in, parameterName=code_block_3, value=getItemAtIndex)
